# Grasshopper definition URBANO hops.gh (Grasshopper 1.0.7)
# plug-ins: Hops, ShapeDiverForGrasshopper

floor_ht = Slider(4, range=3..10)
no_of_floor = Slider(20, range=3..30)
office = Slider(14, range=0..100)
panel = Panel("Commercial")
residential = Slider(40, range=0..100)
no_of_floor_2 = Slider(12, range=2..30)
floor_ht_2 = Slider(4, range=3..10)
sddp = ShapeDiverDocumentPayload({AbsoluteTolerance=0, AngleTolerance=0, DistanceDisplayPrecision=0, GltfVersion="Gltf2", GrasshopperVersion="1.0.0007", InputGroups="{}", OutputGroups="{}", RelativeTolerance=0, RhinoVersion="7.34.23267.11001", UnitSystem=0, VersionCreated="1.16.0.0", VersionSaved="1.16.0.0"})
curve = Curve(<curve referenced from the Rhino model>)
path = FilePath("C:\Users\Admin\Downloads\map (2).osm")
txt = Text("43")
hops = Hops(
    BuildingType=Slider(0, range=0..1),
    BuildingCurve=curve,
    ResidentialBuildingName="Residential",
    ResidentialAreaPerPerson=residential,
    ResidentialNoOfFloor=no_of_floor_2,
    ResidentialFloorToFloorHt=floor_ht_2,
    CommercialBuildingName="Commercial",
    CommercialAreaPerPerson=14,
    CommercialNoOfFloor=20,
    CommercialFloorToFloorHt=4,
    Left="73.9041",
    Right="73.9267",
    Top="18.5739",
    Bottom="18.5535",
    OSMFilePath=path,
    UTM=txt,
    CacheResultsInMemory=True,
    CacheSolveResults=True,
    RemoteDefinitionLocation="D:\Master in Computation design\MODULE 2\data management\final project\b. potential investment options\URBANO base file for hoops.gh",
    RemoteSolveVersion=(0, 1, 0),
    ShowInput_Enabled=False,
    ShowInput_Path=False,
    SynchronousSolve=True)  # -> ResidentialBuildings, CommercialBuildings, ProposedBuildingName, Height, Occupancy, TotalBuiltUpArea, AreaPerPerson, ProposedBuilding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
custom_preview = CustomPreview(Geometry=hops.RecreationalAreas, Material=hops.RecreationalColorCode)
