# Grasshopper definition Updated_Urban_Impact_Analyzer_Hops.gh (Grasshopper 1.0.7)
# plug-ins: Hops, ShapeDiverForGrasshopper, Human

no_of_floor = Slider(14, range=2..30)
residential = Slider(32, range=0..100)
floor_ht = Slider(4, range=3..10)
panel = Panel("Appartment")

panel_2 = Panel("2.2059")
panel_3 = Panel("41.4032")
panel_4 = Panel("2.1967")
panel_5 = Panel("41.4102")
path = FilePath("C:\Users\Admin\Downloads\map (3).osm")
txt = Text("31T")

path_2 = FilePath("C:\Users\Admin\Downloads\map (2).osm")
txt_2 = Text("43")

sddp = ShapeDiverDocumentPayload({AbsoluteTolerance=0, AngleTolerance=0, DistanceDisplayPrecision=0, GltfVersion="Gltf2", GrasshopperVersion="1.0.0007", InputGroups="{}", OutputGroups="{}", RelativeTolerance=0, RhinoVersion="7.34.23267.11001", UnitSystem=0, VersionCreated="1.16.0.0", VersionSaved="1.16.0.0"})
no_of_floor_2 = Slider(18, range=3..30)
office = Slider(14, range=0..100)
floor_ht_2 = Slider(4, range=3..10)
curve = Curve(<curve referenced from the Rhino model>)
panel_6 = Panel(txt_2)
hops = Hops(
    BuildingType=Slider(1, range=0..1),
    BuildingCurve=curve,
    BuildingName="Commercial Complex",
    AreaPerPerson=office,
    NoOfFloor=no_of_floor_2,
    FloorToFloorHt=floor_ht_2,
    Left="73.9041",
    Right="73.9267",
    Top="18.5739",
    Bottom="18.5535",
    OSMFilePath=path_2,
    UTM=txt_2,
    CacheResultsInMemory=True,
    CacheSolveResults=True,
    RemoteDefinitionLocation="D:\Master in Computation design\MODULE 2\data management\final project\b. potential investment options\Updated_Urban_Impact_Analyzer.gh",
    RemoteSolveVersion=(0, 1, 0),
    ShowInput_Enabled=False,
    ShowInput_Path=False,
    SynchronousSolve=True)  # -> ResidentialBuildings, ResidentialBuildingColorCode, CommercialBuildings, CommercialBuildingColorCode, BuildingType, ProposedBuildingName, Height, Occupancy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

curve_middle = CurveMiddle(Curve=hops.StreetCurve)
custom_preview_lineweights = CustomPreviewLineweights(
    Geometry=hops.StreetCurve,
    Shader={diffuse=RGB(255, 105, 180), emission=RGB(76, 32, 54), shine=0.5, specular=RGB(255, 255, 255), transparency=0},
    Absolute=False)
render_text_to_screen = RenderTextToScreen(Text=hops.StreetHits, Location=curve_middle, Size=6, Color=RGB(0, 0, 0), m_scWithvp=False)

custom_preview = CustomPreview(Geometry=hops.CommercialBuildings, Material=hops.CommercialBuildingColorCode)
custom_preview_2 = CustomPreview(Geometry=hops.ResidentialBuildings, Material=hops.ResidentialBuildingColorCode)
custom_preview_3 = CustomPreview(Geometry=hops.ProposedBuilding, Material=hops.ProposedBuildingColorCode)
custom_preview_4 = CustomPreview(Geometry=hops.RecreationalAreas, Material=hops.RecreationalColorCode)
