# Grasshopper definition Updated_Urban_Impact_Analyzer_base_hops_file.gh (Grasshopper 1.0.7)
# plug-ins: Urbano, ShapeDiverForGrasshopper, Human

panel = Panel("73.9267")
panel_2 = Panel("18.5535")
panel_3 = Panel("73.9041")
panel_4 = Panel("18.5739")
path = FilePath("C:\Users\Admin\Downloads\map (2).osm")
txt = Text("43")

panel_5 = Panel("2.2059")
panel_6 = Panel("41.4032")
panel_7 = Panel("2.1967")
panel_8 = Panel("41.4102")
path_2 = FilePath("C:\Users\Admin\Downloads\map (3).osm")
txt_2 = Text("31T")

residential = Slider(40, range=0..100)
floor_ht = Slider(4, range=3..10)
no_of_floor = Slider(12, range=2..30)
number_slider = Slider(0, range=0..1)
panel_9 = Panel("Residential")
curve = Curve(<curve referenced from the Rhino model>)

left = GetNumber(AtLeast=1, AtMost=1, Maximum=1.797693135e+308, Minimum=-1.797693135e+308, TreeAccess=False)
right = GetNumber(AtLeast=1, AtMost=1, Maximum=1.797693135e+308, Minimum=-1.797693135e+308, TreeAccess=False)
top = GetNumber(AtLeast=1, AtMost=1, Maximum=1.797693135e+308, Minimum=-1.797693135e+308, TreeAccess=False)
bottom = GetNumber(AtLeast=1, AtMost=1, Maximum=1.797693135e+308, Minimum=-1.797693135e+308, TreeAccess=False)
osm_file_path = GetFilePath(AtLeast=1, AtMost=1, TreeAccess=False)
utm = GetString(AtLeast=1, AtMost=1, Prompt="UTM zone of the region", TreeAccess=False)
building_type = GetInteger(AtLeast=1, AtMost=1, Maximum=2147483647, Minimum=-2147483648, Prompt="0 - Residential; 1 - Commercial", TreeAccess=False)
building_curve = GetGeometry(AtLeast=1, AtMost=1, DeleteInput=True, Filter=1074004029, TreeAccess=False)
building_name = GetString(AtLeast=1, AtMost=1, TreeAccess=False)
area_per_person = GetInteger(AtLeast=1, AtMost=1, Maximum=2147483647, Minimum=-2147483648, TreeAccess=False)
no_of_floor_2 = GetInteger(AtLeast=1, AtMost=1, Maximum=2147483647, Minimum=-2147483648, TreeAccess=False)
floor_to_floor_ht = GetInteger(AtLeast=1, AtMost=1, Maximum=2147483647, Minimum=-2147483648, TreeAccess=False)
area = Area(Geometry=building_curve)  # -> Area, Centroid

multiplication = Multiplication(A=no_of_floor_2, B=floor_to_floor_ht)
sddp = ShapeDiverDocumentPayload({AbsoluteTolerance=0, AngleTolerance=0, DistanceDisplayPrecision=0, GltfVersion="Gltf2", GrasshopperVersion="1.0.0007", InputGroups="{}", OutputGroups="{}", RelativeTolerance=0, RhinoVersion="7.34.23267.11001", UnitSystem=0, VersionCreated="1.16.0.0", VersionSaved="1.16.0.0"})
division = Division(A=area.Area, B=area_per_person)
multiplication_2 = Multiplication(A=area.Area, B=multiplication)
population = Integer(division)
format = Format(Format="{0:0.00}", Culture=127, Data0=multiplication_2)

downloadosm = DownloadOpenStreetMapOSM(LeftBound=left, RightBound=right, TopBound=top, BottomBound=bottom, FilePath=osm_file_path, RunToggle=Toggle(True))  # -> OSMQueryURL, OSMFilePath
importosm = ImportOSMFeatures(OSMPathOrURL=osm_file_path, OSMFeatureType="building", Format="xml", UTMZone=utm, ImportAltitude=False)  # -> Points, Metadata, UTMZone, TranslationVector
importosm_2 = ImportOSMFeatures(OSMPathOrURL=osm_file_path, OSMFeatureType="amenity", Format="xml", UTMZone=utm, ImportAltitude=False)  # -> Points, Metadata, UTMZone, TranslationVector
importosm_3 = ImportOSMFeatures(OSMPathOrURL=osm_file_path, OSMFeatureType="street", Format="xml", UTMZone=utm, ImportAltitude=False)  # -> Points, Metadata, UTMZone, TranslationVector
importosm_4 = ImportOSMFeatures(OSMPathOrURL=osm_file_path, OSMFeatureType="leisure", Format="xml", UTMZone=utm, ImportAltitude=False)  # -> Points, Metadata, UTMZone, TranslationVector
panel_10 = Panel(downloadosm.OSMQueryURL)
panel_11 = Panel(downloadosm.OSMFilePath)
create_amenity = CreateAmenity(PointLocationOfAmenity=importosm_2.Points, Metadata=importosm_2.Metadata)
pline = PolyLine(Vertices=importosm_3.Points, Closed=False)
polyline = PolyLine(Vertices=importosm_4.Points, Closed=False)
pline_2 = PolyLine(Vertices=importosm.Points, Closed=False)
deconstruct_metadata = DeconstructMetadata(Metadata=importosm.Metadata)  # -> Keys, Values
create_street_network = CreateStreetNetwork(
    StreetCurves=flatten(pline),
    Metadata=flatten(importosm_3.Metadata),
    SplitStreetCurves=True,
    UTMZone=importosm_3.UTMZone,
    TranslationVector=importosm_3.TranslationVector)  # -> StreetNetwork, StreetSegmentCurves, UTMZone, TranslationVector
boundary_surfaces = BoundarySurfaces(Edges=polyline)
panel_12 = Panel(deconstruct_metadata.Keys)
arrange_amenities_by_building = ArrangeAmenitiesByBuilding(Amenities=flatten(create_amenity), Buildings=flatten(pline_2))  # -> AmenitiesByBuilding, Buildings
colour_swatch = ColourSwatch(SwatchColor=RGB(36, 15, 15))
panel_13 = Panel(deconstruct_metadata.Values)
custom_preview = CustomPreview(Geometry=create_street_network.StreetSegmentCurves, Material=colour_swatch)
residential_2 = Entwine(
    Branch00=building_name,
    Branch01=multiplication,
    Branch02=population,
    Branch03=format,
    Branch04=area_per_person,
    FlattenInputs=True)
commercial = Entwine(
    Branch00=building_name,
    Branch01=multiplication,
    Branch02=population,
    Branch03=format,
    Branch04=area_per_person,
    FlattenInputs=True)
custom_preview_lineweights = CustomPreviewLineweights(Geometry=create_street_network.StreetSegmentCurves, Shader=colour_swatch, Absolute=False)
create_metadata = CreateMetadata(
    KeysInMetadata=["name", "height", "residential_population", "residential_area", "residential_area_per_person"],
    ValuesInMetadata=flatten(residential_2))
create_metadata_2 = CreateMetadata(
    KeysInMetadata=["name", "height", "office_population", "office_area", "office_area_per_person"],
    ValuesInMetadata=flatten(commercial))
stream_filter = StreamFilter(Gate=building_type, Stream0=create_metadata, Stream1=create_metadata_2)
create_building = CreateBuilding(BuildingCurve=building_curve, Metadata=stream_filter)
create_building_2 = CreateBuilding(
    BuildingCurve=pline_2,
    Metadata=importosm.Metadata,
    AmenitiesInBuilding=arrange_amenities_by_building.AmenitiesByBuilding)
entwine = Entwine(Branch00=create_building, Branch01=create_building_2, FlattenInputs=True)  # -> flatten(Result)
build_urbano_model = BuildUrbanoModel(Buildings=flatten(entwine), StreetNetwork=create_street_network.StreetNetwork, BuildToggle=True)  # -> UrbanoModel, BuildingCurves, Activities
inspect_building = InspectBuilding(Building=create_building_2, UrbanoModel=build_urbano_model.UrbanoModel, DefaultHeight=10)  # -> Geometry, Metadata, Amenity, BuildingMesh

tree_statistics = TreeStatistics(Tree=deconstruct_metadata.Values)  # -> Paths, Length, Count
smaller_than = SmallerThan(FirstNumber=tree_statistics.Length, SecondNumber=Slider(2, range=0..10))  # -> SmallerThan, graft(OrEqualTo)
dispatch = Dispatch(List=deconstruct_metadata.Values, DispatchPattern=smaller_than.OrEqualTo)  # -> ListA, ListB
dispatch_2 = Dispatch(List=inspect_building.BuildingMesh, DispatchPattern=smaller_than.OrEqualTo)  # -> ListA, ListB
concatenate = Concatenate(A="*", Fragment_B="*apartments", B="*")
concatenate_2 = Concatenate(A="*", Fragment_B="*House", B="*")
concatenate_3 = Concatenate(A="*", Fragment_B="*residential", B="*")
list_item = ListItem(List=dispatch.ListB, Index=0, Wrap=True)
merge = Merge(Data1=concatenate, Data2=concatenate_2, Data3=concatenate_3)
match_text = MatchText(Text=list_item, Pattern=graft(merge), Case=invert(True))
dispatch_3 = Dispatch(List=dispatch_2.ListB, DispatchPattern=match_text)  # -> ListA, ListB

colour_swatch_2 = ColourSwatch(SwatchColor=RGB(232, 229, 139))
custom_preview_2 = CustomPreview(Geometry=dispatch_2.ListA, Material=colour_swatch_2)
custom_preview_3 = CustomPreview(Geometry=dispatch_3.ListA, Material=colour_swatch_2)

colour_swatch_3 = ColourSwatch(SwatchColor=RGB(146, 143, 227))
custom_preview_4 = CustomPreview(Geometry=dispatch_3.ListB, Material=colour_swatch_3)

inspect_building_2 = InspectBuilding(Building=entwine, UrbanoModel=build_urbano_model.UrbanoModel, DefaultHeight=10)  # -> Geometry, Metadata, Amenity, BuildingMesh
list_item_2 = ListItem(List=inspect_building_2.BuildingMesh, Index=0, Wrap=True)
adper = ActivityDemandProfilePersona(
    ColumnIndex=Slider(1, range=0..10),
    Normalize=False,
    Persona="""post_office,0,0,0,0,0,0,0,0,0,0.001,0.001,0.001,0.001,0.001,0.001,0.001,0.001,0.001,0.001,0,0,0,0,0
bank,0,0,0,0,0,0,0,0,0.004,0.01,0.012,0.014,0.015,0.017,0.017,0.017,0.015,0.01,0.002,0.002,0.002,0.002,0,0
cinema,0,0,0,0,0,0,0,0,0,0,0,0.003,0.006,0.009,0.012,0.015,0.019,0.026,0.037,0.047,0.05,0.043,0.03,0.017
theatre,0,0,0,0,0,0,0,0,0,0,0.001,0.001,0.004,0.005,0.005,0.005,0.005,0.007,0.02,0.048,0.023,0.021,0.014,0.009
arts_centre,0,0,0,0,0,0,0,0,0,0.003,0.003,0.003,0.003,0.003,0.003,0.007,0.01,0.017,0.017,0.017,0.014,0,0,0
pharmacy,0.011,0.005,0.005,0.003,0.003,0.003,0.008,0.016,0.03,0.041,0.049,0.057,0.063,0.068,0.071,0.073,0.076,0.076,0.071,0.06,0.049,0.041,0.03,0.019
restaurant,0.01,0,0,0,0,0,0,0.01,0.021,0.031,0.041,0.072,0.124,0.144,0.124,0.093,0.083,0.113,0.155,0.175,0.165,0.124,0.072,0.031
fast_food,0.001,0.001,0,0,0,0.001,0.003,0.006,0.007,0.005,0.005,0.011,0.019,0.022,0.016,0.012,0.012,0.013,0.015,0.015,0.012,0.008,0.004,0.002
cafe,0,0,0,0,0,0.003,0.014,0.039,0.055,0.055,0.053,0.05,0.053,0.055,0.055,0.053,0.047,0.042,0.036,0.028,0.017,0.008,0.006,0
bar,0.031,0.02,0.015,0.005,0,0,0,0,0,0,0,0.01,0.02,0.02,0.026,0.026,0.041,0.061,0.087,0.102,0.102,0.097,0.087,0.072
pub,0.031,0.02,0.015,0.005,0,0,0,0,0,0,0,0.01,0.02,0.02,0.026,0.026,0.041,0.061,0.087,0.102,0.102,0.097,0.087,0.072
department_store,0,0,0,0,0,0,0,0,0.002,0.004,0.007,0.01,0.013,0.015,0.015,0.015,0.016,0.017,0.016,0.012,0.008,0.003,0,0
supermarket_store,0.004,0.002,0,0,0.002,0.002,0.004,0.009,0.017,0.023,0.03,0.036,0.043,0.045,0.045,0.043,0.045,0.049,0.049,0.045,0.034,0.023,0.015,0.009
convenience_store,0.003,0.002,0.002,0.002,0.002,0.003,0.004,0.006,0.008,0.008,0.008,0.009,0.01,0.01,0.011,0.01,0.008,0.007,0.007,0.006,0.006,0.006,0.005,0.004
hardware_store,0,0,0,0,0,0,0,0,0.005,0.011,0.014,0.014,0.015,0.015,0.014,0.013,0.01,0.005,0.003,0.002,0.001,0.001,0.001,0
clothes_store,0,0,0,0,0,0,0,0,0,0.011,0.033,0.055,0.066,0.077,0.077,0.077,0.088,0.099,0.088,0.055,0.022,0,0,0
books_store,0,0,0,0,0,0,0,0,0,0.002,0.002,0.005,0.007,0.008,0.009,0.008,0.009,0.01,0.011,0.009,0.002,0.001,0,0
shoes_store,0,0,0,0,0,0,0,0,0,0.003,0.009,0.014,0.018,0.02,0.022,0.023,0.025,0.026,0.025,0.015,0.006,0.002,0,0
beauty_store,0,0,0,0,0,0,0,0,0.003,0.006,0.013,0.019,0.022,0.029,0.029,0.029,0.029,0.035,0.035,0.026,0.013,0.006,0.003,0""")
panel_14 = Panel(adper)
adptripeng = ADPTripEngine(
    UrbanoModel=build_urbano_model.UrbanoModel,
    Building=build_urbano_model.BuildingCurves,
    ActivityDemandProfile=adper,
    SingleTravelMode="car",
    DestinationChoiceModel="nearest",
    DestinationFactorKeys=["amenity_capacity", "amenity_opening", "amenity_ranking", "custom_destination_factor"],
    TimeLimit=Slider(20, range=0..100),
    BuildToggle=True)
bldghits = BuildingHits(Trips=flatten(adptripeng))  # -> BuildingCurves, BuildingHits, BuildingTrips
amenhits = AmenityHits(Trips=flatten(adptripeng))  # -> Amenity, AmenityHits, AmenityHosts, AmTrips
sthits = StreetHits(UrbanoModel=build_urbano_model.UrbanoModel, Trips=flatten(adptripeng))  # -> StreetCurves, StreetHits, StTrips
walksc = TripWalkscore(Trip=adptripeng)
area_2 = Area(Geometry=bldghits.BuildingCurves)  # -> flatten(Area), flatten(Centroid)
curve_middle = CurveMiddle(Curve=sthits.StreetCurves)  # -> flatten(Midpoint)
# if building is close to high strret hits it
# will be commercial and less will be residential
geometry = Geometry(list_item_2)
area_3 = Area(Geometry=geometry)  # -> Area, Centroid
bounds = Bounds(Numbers=sthits.StreetHits)
project = Project(Geometry=area_3.Centroid, Plane=PlaneXY(0, 0, 0))  # -> Geometry, Transform
deconstruct_domain = DeconstructDomain(Domain=bounds)  # -> Start, End
division_2 = Division(A=deconstruct_domain.End, B="3")
closest_points = ClosestPoints(Point=project.Geometry, Cloud=flatten(area_2.Centroid), Count="1")  # -> ClosestPoint, CPIndex, Distance
closest_points_2 = ClosestPoints(Point=project.Geometry, Cloud=flatten(curve_middle), Count="5")  # -> ClosestPoint, CPIndex, Distance
smaller_than_2 = SmallerThan(FirstNumber=closest_points.Distance, SecondNumber=Slider(200, range=0..1000))  # -> SmallerThan, OrEqualTo
list_item_3 = ListItem(List=sthits.StreetHits, Index=closest_points.CPIndex, Wrap=True)
list_item_4 = ListItem(List=sthits.StreetHits, Index=closest_points_2.CPIndex, Wrap=True)
bounds_2 = Bounds(Numbers=list_item_3)
bounds_3 = Bounds(Numbers=list_item_4)
deconstruct_metadata_2 = DeconstructMetadata(Metadata=stream_filter)  # -> Keys, graft(Values)
panel_15 = Panel(closest_points_2.CPIndex)
deconstruct_domain_2 = DeconstructDomain(Domain=bounds_2)  # -> Start, End
deconstruct_domain_3 = DeconstructDomain(Domain=bounds_3)  # -> Start, End
smaller_than_3 = SmallerThan(FirstNumber=deconstruct_domain_3.End, SecondNumber=division_2)  # -> SmallerThan, OrEqualTo
panel_16 = Panel(deconstruct_metadata_2.Values)
explode_tree = ExplodeTree(Data=deconstruct_metadata_2.Values)  # -> Branch0, Branch1, Branch2, Branch3, Branch4
dispatch_4 = Dispatch(List=deconstruct_domain_2.End, DispatchPattern=smaller_than_2.SmallerThan)  # -> ListA, ListB
dispatch_5 = Dispatch(List=deconstruct_domain_3.End, DispatchPattern=smaller_than_3.SmallerThan)  # -> ListA, ListB
merge_2 = Merge(Data1=dispatch_3.ListA, Data2=dispatch_2.ListA)
colour_swatch_4 = ColourSwatch(SwatchColor=RGB(113, 186, 71))

colour_swatch_5 = ColourSwatch(SwatchColor=RGB(222, 164, 164))
geometry_2 = Geometry(geometry)
custom_preview_5 = CustomPreview(Geometry=list_item_2, Material=colour_swatch_5)

curve_2 = Curve(create_street_network.StreetSegmentCurves)
custom_preview_6 = CustomPreview(Geometry=boundary_surfaces, Material=colour_swatch_4)
boolean = Boolean(smaller_than_3.SmallerThan)

curve_3 = Curve(bldghits.BuildingCurves)
number = Number(bldghits.BuildingHits)
trip = Trip(bldghits.BuildingTrips)

boolean_2 = Boolean(smaller_than_2.SmallerThan)

geometry_3 = Geometry(merge_2)
geometry_4 = Geometry(dispatch_3.ListB)

integer = Integer(building_type)
curve_4 = Curve(sthits.StreetCurves)
number_2 = Number(sthits.StreetHits)
surface = Surface(boundary_surfaces)
context_print = ContextPrint(NearbyAminityIn200mRadius=boolean_2)
context_print_2 = ContextPrint(RecreationalColorCode=colour_swatch_4)
context_print_3 = ContextPrint(CommercialResidential=boolean)
context_print_4 = ContextPrint(ClosestAminityDistannce=closest_points.Distance)
context_print_5 = ContextPrint(ProposedBuildingName=explode_tree.Branch0)
context_print_6 = ContextPrint(ProposedBuildingColorCode=colour_swatch_5)
context_bake = ContextBake(RecreationalAreas=surface)
context_bake_2 = ContextBake(ProposedBuilding=geometry_2)
context_print_7 = ContextPrint(TotalBuiltUpArea=explode_tree.Branch3)
context_print_8 = ContextPrint(StreetNetwork=curve_2)
context_print_9 = ContextPrint(AreaPerPerson=explode_tree.Branch4)
context_bake_3 = ContextBake(BuildingCurve=curve_3)
context_print_10 = ContextPrint(AminityHits=number)
context_bake_4 = ContextBake(StreetCurve=curve_4)
context_print_11 = ContextPrint(StreetHits=number_2)
context_print_12 = ContextPrint(Occupancy=explode_tree.Branch2)
context_print_13 = ContextPrint(BuildingType=integer)
context_print_14 = ContextPrint(Height=explode_tree.Branch1)
context_print_15 = ContextPrint(CommercialBuildingColorCode=colour_swatch_3)
context_print_16 = ContextPrint(ResidentialBuildingColorCode=colour_swatch_2)
context_bake_5 = ContextBake(ResidentialBuildings=geometry_3)
context_bake_6 = ContextBake(CommercialBuildings=geometry_4)
