# Grasshopper definition Urban_Impact_Analyzer.gh (Grasshopper 1.0.7)
# plug-ins: Urbano, ShapeDiverForGrasshopper, Pufferfish, Human

floor_ht = Slider(4, range=3..10)
floor_ht_2 = Slider(4, range=3..10)
no_of_floor = Slider(12, range=2..30)
no_of_floor_2 = Slider(20, range=3..30)
curve = Curve(<curve referenced from the Rhino model>)
path = FilePath("C:\Users\Admin\Downloads\map (2).osm")
txt = Text("43")
utm = GetString(txt, AtLeast=1, AtMost=1, Prompt="UTM zone of the region", TreeAccess=False)
left = GetNumber("73.9041", AtLeast=1, AtMost=1, Maximum=1.797693135e+308, Minimum=-1.797693135e+308, TreeAccess=False)
right = GetNumber("73.9267", AtLeast=1, AtMost=1, Maximum=1.797693135e+308, Minimum=-1.797693135e+308, TreeAccess=False)
top = GetNumber("18.5739", AtLeast=1, AtMost=1, Maximum=1.797693135e+308, Minimum=-1.797693135e+308, TreeAccess=False)
bottom = GetNumber("18.5535", AtLeast=1, AtMost=1, Maximum=1.797693135e+308, Minimum=-1.797693135e+308, TreeAccess=False)
osm_file_path = GetFilePath(path, AtLeast=1, AtMost=1, TreeAccess=False)
building_type = GetInteger(
    Slider(0, range=0..1),
    AtLeast=1,
    AtMost=1,
    Maximum=2147483647,
    Minimum=-2147483648,
    Prompt="0 - Residential; 1 - Commercial",
    TreeAccess=False)
building_curve = GetGeometry(curve, AtLeast=1, AtMost=1, DeleteInput=False, Filter=1074004029, TreeAccess=False)
residential_building_name = GetString("Residential", AtLeast=1, AtMost=1, TreeAccess=False)
residential_no_of_floor = GetInteger(no_of_floor, AtLeast=1, AtMost=1, Maximum=2147483647, Minimum=-2147483648, TreeAccess=False)
residential_floor_to_floor_ht = GetInteger(floor_ht, AtLeast=1, AtMost=1, Maximum=2147483647, Minimum=-2147483648, TreeAccess=False)
commercial_building_name = GetString("Commercial", AtLeast=1, AtMost=1, TreeAccess=False)
commercial_no_of_floor = GetInteger(no_of_floor_2, AtLeast=1, AtMost=1, Maximum=2147483647, Minimum=-2147483648, TreeAccess=False)
commercial_floor_to_floor_ht = GetInteger(floor_ht_2, AtLeast=1, AtMost=1, Maximum=2147483647, Minimum=-2147483648, TreeAccess=False)
multiplication = Multiplication(A=residential_no_of_floor, B=residential_floor_to_floor_ht)
multiplication_2 = Multiplication(A=commercial_no_of_floor, B=commercial_floor_to_floor_ht)
construct_domain = ConstructDomain(DomainStart=0, DomainEnd=1)
area = Area(Geometry=building_curve)  # -> Area, Centroid
# Am I using an external plugin?
toggle = BooleanToggle(True)
importosm = ImportOSMFeatures(OSMPathOrURL=osm_file_path, OSMFeatureType="leisure", Format="xml", UTMZone=utm, ImportAltitude=False)  # -> Points, Metadata, UTMZone, TranslationVector
downloadosm = DownloadOpenStreetMapOSM(LeftBound=left, RightBound=right, TopBound=top, BottomBound=bottom, FilePath=osm_file_path, RunToggle=Toggle(True))  # -> OSMQueryURL, OSMFilePath
importosm_2 = ImportOSMFeatures(OSMPathOrURL=osm_file_path, OSMFeatureType="building", Format="xml", UTMZone=utm, ImportAltitude=False)  # -> Points, Metadata, UTMZone, TranslationVector
importosm_3 = ImportOSMFeatures(OSMPathOrURL=osm_file_path, OSMFeatureType="amenity", Format="xml", UTMZone=utm, ImportAltitude=False)  # -> Points, Metadata, UTMZone, TranslationVector
importosm_4 = ImportOSMFeatures(OSMPathOrURL=osm_file_path, OSMFeatureType="street", Format="xml", UTMZone=utm, ImportAltitude=False)  # -> Points, Metadata, UTMZone, TranslationVector
importosm_5 = ImportOSMFeatures(OSMPathOrURL=osm_file_path, OSMFeatureType="landuse", Format="xml", UTMZone=utm, ImportAltitude=False)  # -> Points, Metadata, UTMZone, TranslationVector; disabled
dependencies = GhPythonScript(Find=toggle)  # -> Dep; inputs Find: Boolean
# ---------- dependencies: Python ----------
import Grasshopper as gh
if Find:

    asms = {}
    
    for obj in ghenv.Component.OnPingDocument().Objects:
        asm = gh.Instances.ComponentServer.FindAssemblyByObject(obj.ComponentGuid)

        if asm is not None and not asm.IsCoreLibrary:
            asms[asm.Name]=asm.Version
    
    
    if len(asms)==1: Dep= "No dependencies aparently... You are good"
    else: Dep = asms
    

    ghenv.Component.ExpireSolution(True)
    
else:
    Dep= "Toggle Find  to check"
# ---------- end dependencies ----------
panel = Panel(downloadosm.OSMQueryURL)
panel_2 = Panel(downloadosm.OSMFilePath)
polyline = PolyLine(Vertices=importosm.Points, Closed=False)
deconstruct_metadata = DeconstructMetadata(Metadata=importosm.Metadata)  # -> Keys, Values
create_amenity = CreateAmenity(PointLocationOfAmenity=importosm_3.Points, Metadata=importosm_3.Metadata)
pline = PolyLine(Vertices=importosm_4.Points, Closed=False)
polyline_2 = PolyLine(Vertices=importosm_5.Points, Closed=False)  # disabled
deconstruct_metadata_2 = DeconstructMetadata(Metadata=importosm_5.Metadata)  # -> Keys, Values; disabled
pline_2 = PolyLine(Vertices=importosm_2.Points, Closed=False)
deconstruct_metadata_3 = DeconstructMetadata(Metadata=importosm_2.Metadata)  # -> Keys, Values
point = Point(importosm_3.Points)
panel_3 = Panel(dependencies)
number_slider = Slider(17, range=0..100)  # disabled
number_slider_2 = Slider(2, range=0..100)  # disabled
number_slider_3 = Slider(26, range=0..100)  # disabled
create_street_network = CreateStreetNetwork(
    StreetCurves=flatten(pline),
    Metadata=flatten(importosm_4.Metadata),
    SplitStreetCurves=True,
    UTMZone=importosm_4.UTMZone,
    TranslationVector=importosm_4.TranslationVector)  # -> StreetNetwork, StreetSegmentCurves, UTMZone, TranslationVector
boundary_surfaces = BoundarySurfaces(Edges=polyline)
list_item = ListItem(List=deconstruct_metadata.Values, Index=0, Wrap=True)
boundary_surfaces_2 = BoundarySurfaces(Edges=polyline_2)  # -> flatten(Surfaces); disabled
list_item_2 = ListItem(List=deconstruct_metadata_2.Values, Index=0, Wrap=True)  # -> flatten(Item); disabled
panel_4 = Panel(deconstruct_metadata_3.Keys)
merge = Merge(Data2=polyline)
create_set = CreateSet(List=list_item_2)  # -> Set, Map; disabled
list_item_3 = ListItem(List=boundary_surfaces_2, Index=number_slider, Wrap=True)  # disabled
list_item_4 = ListItem(List=boundary_surfaces_2, Index=number_slider_2, Wrap=True)  # disabled
list_item_5 = ListItem(List=boundary_surfaces_2, Index=number_slider_3, Wrap=True)  # disabled
arrange_amenities_by_building = ArrangeAmenitiesByBuilding(Amenities=flatten(create_amenity), Buildings=flatten(pline_2))  # -> AmenitiesByBuilding, Buildings
colour_swatch = ColourSwatch(SwatchColor=RGB(36, 15, 15))
panel_5 = Panel(deconstruct_metadata_3.Values)
custom_preview = CustomPreview(Geometry=create_street_network.StreetSegmentCurves, Material=colour_swatch)
bounds = Bounds(Numbers=create_set.Map)  # disabled
deconstruct_domain = DeconstructDomain(Domain=bounds)  # -> Start, End; disabled
list_item_6 = ListItem(Index=0, Wrap=True)  # disabled
path_mapper = PathMapper(deconstruct_metadata_3.Keys, source="{a;b}", target="{b;a}")
path_mapper_2 = PathMapper(deconstruct_metadata_3.Values, source="{a;b}", target="{b;a}")
custom_preview_lineweights = CustomPreviewLineweights(Geometry=create_street_network.StreetSegmentCurves, Shader=colour_swatch, Absolute=False)
gradient = Gradient(
    LowerLimit=deconstruct_domain.End,
    UpperLimit=deconstruct_domain.Start,
    Parameter=create_set.Map,
    stops=[0.299: RGB(255, 255, 255), 1: RGB(0, 0, 0)])  # disabled
colour_swatch_2 = ColourSwatch(SwatchColor=RGB(224, 224, 224))  # disabled
custom_preview_2 = CustomPreview(Geometry=[list_item_4, list_item_3, list_item_5], Material=graft(colour_swatch_2))  # disabled
custom_preview_3 = CustomPreview(Geometry=graft(boundary_surfaces_2), Material=graft(gradient))  # disabled
create_building = CreateBuilding(
    BuildingCurve=pline_2,
    Metadata=importosm_2.Metadata,
    AmenitiesInBuilding=arrange_amenities_by_building.AmenitiesByBuilding)
adper = ActivityDemandProfilePersona(
    LoadADPData="Manhattan, NYC - Weekday (24hr)",
    ColumnIndex=Slider(1, range=0..10),
    Normalize=False,
    Persona="""post_office,0,0,0,0,0,0,0,0,0,0.001,0.001,0.001,0.001,0.001,0.001,0.001,0.001,0.001,0.001,0,0,0,0,0
bank,0,0,0,0,0,0,0,0,0.004,0.01,0.012,0.014,0.015,0.017,0.017,0.017,0.015,0.01,0.002,0.002,0.002,0.002,0,0
cinema,0,0,0,0,0,0,0,0,0,0,0,0.003,0.006,0.009,0.012,0.015,0.019,0.026,0.037,0.047,0.05,0.043,0.03,0.017
theatre,0,0,0,0,0,0,0,0,0,0,0.001,0.001,0.004,0.005,0.005,0.005,0.005,0.007,0.02,0.048,0.023,0.021,0.014,0.009
arts_centre,0,0,0,0,0,0,0,0,0,0.003,0.003,0.003,0.003,0.003,0.003,0.007,0.01,0.017,0.017,0.017,0.014,0,0,0
pharmacy,0.011,0.005,0.005,0.003,0.003,0.003,0.008,0.016,0.03,0.041,0.049,0.057,0.063,0.068,0.071,0.073,0.076,0.076,0.071,0.06,0.049,0.041,0.03,0.019
restaurant,0.01,0,0,0,0,0,0,0.01,0.021,0.031,0.041,0.072,0.124,0.144,0.124,0.093,0.083,0.113,0.155,0.175,0.165,0.124,0.072,0.031
fast_food,0.001,0.001,0,0,0,0.001,0.003,0.006,0.007,0.005,0.005,0.011,0.019,0.022,0.016,0.012,0.012,0.013,0.015,0.015,0.012,0.008,0.004,0.002
cafe,0,0,0,0,0,0.003,0.014,0.039,0.055,0.055,0.053,0.05,0.053,0.055,0.055,0.053,0.047,0.042,0.036,0.028,0.017,0.008,0.006,0
bar,0.031,0.02,0.015,0.005,0,0,0,0,0,0,0,0.01,0.02,0.02,0.026,0.026,0.041,0.061,0.087,0.102,0.102,0.097,0.087,0.072
pub,0.031,0.02,0.015,0.005,0,0,0,0,0,0,0,0.01,0.02,0.02,0.026,0.026,0.041,0.061,0.087,0.102,0.102,0.097,0.087,0.072
department_store,0,0,0,0,0,0,0,0,0.002,0.004,0.007,0.01,0.013,0.015,0.015,0.015,0.016,0.017,0.016,0.012,0.008,0.003,0,0
supermarket_store,0.004,0.002,0,0,0.002,0.002,0.004,0.009,0.017,0.023,0.03,0.036,0.043,0.045,0.045,0.043,0.045,0.049,0.049,0.045,0.034,0.023,0.015,0.009
convenience_store,0.003,0.002,0.002,0.002,0.002,0.003,0.004,0.006,0.008,0.008,0.008,0.009,0.01,0.01,0.011,0.01,0.008,0.007,0.007,0.006,0.006,0.006,0.005,0.004
hardware_store,0,0,0,0,0,0,0,0,0.005,0.011,0.014,0.014,0.015,0.015,0.014,0.013,0.01,0.005,0.003,0.002,0.001,0.001,0.001,0
clothes_store,0,0,0,0,0,0,0,0,0,0.011,0.033,0.055,0.066,0.077,0.077,0.077,0.088,0.099,0.088,0.055,0.022,0,0,0
books_store,0,0,0,0,0,0,0,0,0,0.002,0.002,0.005,0.007,0.008,0.009,0.008,0.009,0.01,0.011,0.009,0.002,0.001,0,0
shoes_store,0,0,0,0,0,0,0,0,0,0.003,0.009,0.014,0.018,0.02,0.022,0.023,0.025,0.026,0.025,0.015,0.006,0.002,0,0
beauty_store,0,0,0,0,0,0,0,0,0.003,0.006,0.013,0.019,0.022,0.029,0.029,0.029,0.029,0.035,0.035,0.026,0.013,0.006,0.003,0""")
panel_6 = Panel(adper)
colour_swatch_3 = ColourSwatch(SwatchColor=RGB(113, 186, 71))
curve_2 = Curve(create_street_network.StreetSegmentCurves)
custom_preview_4 = CustomPreview(Geometry=boundary_surfaces, Material=colour_swatch_3)
surface = Surface(boundary_surfaces)
context_print = ContextPrint(RecreationalColorCode=colour_swatch_3)
context_bake = ContextBake(RecreationalAreas=surface)
context_print_2 = ContextPrint(StreetNetwork=curve_2)

residential = Slider(40, range=0..100)
sddp = ShapeDiverDocumentPayload({AbsoluteTolerance=0, AngleTolerance=0, DistanceDisplayPrecision=0, GltfVersion="Gltf2", GrasshopperVersion="1.0.0007", InputGroups="{}", OutputGroups="{}", RelativeTolerance=0, RhinoVersion="7.34.23267.11001", UnitSystem=0, VersionCreated="1.16.0.0", VersionSaved="1.16.0.0"})
multiplication_3 = Multiplication(A=area.Area, B=multiplication)
round_to_decimal_place = RoundToDecimalPlace(NumberX=multiplication_3, DecimalPlace="2", RoundType=0)  # -> Rounded, Difference

residential_area_per_person = GetInteger(residential, AtLeast=1, AtMost=1, Maximum=2147483647, Minimum=-2147483648, TreeAccess=False)

division = Division(A=area.Area, B=residential_area_per_person)
population = Integer(division)
entwine = Entwine(Branch00=population, Branch01=round_to_decimal_place.Rounded, FlattenInputs=True)

office = Slider(14, range=0..100)
multiplication_4 = Multiplication(A=area.Area, B=multiplication_2)
round_to_decimal_place_2 = RoundToDecimalPlace(NumberX=multiplication_4, DecimalPlace="2", RoundType=0)  # -> Rounded, Difference

commercial_area_per_person = GetInteger(office, AtLeast=1, AtMost=1, Maximum=2147483647, Minimum=-2147483648, TreeAccess=False)

division_2 = Division(A=area.Area, B=commercial_area_per_person)
population_2 = Integer(division_2)
entwine_2 = Entwine(Branch00=population_2, Branch01=round_to_decimal_place_2.Rounded, FlattenInputs=True)

stream_filter = StreamFilter(Gate=building_type, Stream0=entwine, Stream1=entwine_2)
explode_tree = ExplodeTree(Data=stream_filter)  # -> Branch0, Branch1
residential_2 = Entwine(
    Branch00=residential_building_name,
    Branch01=multiplication,
    Branch02=explode_tree.Branch0,
    Branch03=explode_tree.Branch1,
    Branch04=residential_area_per_person,
    FlattenInputs=True)
commercial = Entwine(
    Branch00=commercial_building_name,
    Branch01=multiplication_2,
    Branch02=explode_tree.Branch0,
    Branch03=explode_tree.Branch1,
    Branch04=commercial_area_per_person,
    FlattenInputs=True)
create_metadata = CreateMetadata(
    KeysInMetadata=["name", "height", "residential_population", "residential_area", "residential_area_per_person"],
    ValuesInMetadata=flatten(residential_2))
create_metadata_2 = CreateMetadata(
    KeysInMetadata=["name", "height", "office_population", "office_area", "office_area_per_person"],
    ValuesInMetadata=flatten(commercial))
stream_filter_2 = StreamFilter(Gate=building_type, Stream0=create_metadata, Stream1=create_metadata_2)
create_building_2 = CreateBuilding(BuildingCurve=building_curve, Metadata=stream_filter_2)
entwine_3 = Entwine(Branch00=create_building_2, Branch01=create_building, FlattenInputs=True)  # -> flatten(Result)
build_urbano_model = BuildUrbanoModel(Buildings=flatten(entwine_3), StreetNetwork=create_street_network.StreetNetwork, BuildToggle=True)  # -> UrbanoModel, BuildingCurves, Activities
inspect_building = InspectBuilding(Building=create_building, UrbanoModel=build_urbano_model.UrbanoModel, DefaultHeight=10)  # -> Geometry, Metadata, Amenity, BuildingMesh

tree_statistics = TreeStatistics(Tree=deconstruct_metadata_3.Values)  # -> Paths, Length, Count
smaller_than = SmallerThan(FirstNumber=tree_statistics.Length, SecondNumber=Slider(2, range=0..10))  # -> SmallerThan, graft(OrEqualTo)
dispatch = Dispatch(List=inspect_building.BuildingMesh, DispatchPattern=smaller_than.OrEqualTo)  # -> ListA, ListB
custom_preview_5 = CustomPreview(Geometry=dispatch.ListA, Material=ColourSwatch(SwatchColor=RGB(232, 229, 139)))

inspect_building_2 = InspectBuilding(Building=dispatch.ListB, UrbanoModel=build_urbano_model.UrbanoModel, DefaultHeight=10)  # -> Geometry, Metadata, Amenity, BuildingMesh; disabled
deconstruct_metadata_4 = DeconstructMetadata(Metadata=inspect_building_2.Metadata)  # -> Keys, Values; disabled
custom_preview_6 = CustomPreview(Geometry=dispatch.ListB, Material=ColourSwatch(SwatchColor=RGB(146, 143, 227)))
panel_7 = Panel(deconstruct_metadata_4.Values)
inspect_building_3 = InspectBuilding(Building=entwine_3, UrbanoModel=build_urbano_model.UrbanoModel, DefaultHeight=10)  # -> Geometry, Metadata, Amenity, BuildingMesh
list_item_7 = ListItem(List=inspect_building_3.BuildingMesh, Index=0, Wrap=True)
adptripeng = ADPTripEngine(
    UrbanoModel=build_urbano_model.UrbanoModel,
    Building=build_urbano_model.BuildingCurves,
    ActivityDemandProfile=adper,
    SingleTravelMode="car",
    DestinationChoiceModel="nearest",
    DestinationFactorKeys=["amenity_capacity", "amenity_opening", "amenity_ranking", "custom_destination_factor"],
    TimeLimit=Slider(20, range=0..100),
    BuildToggle=True)
bldghits = BuildingHits(Trips=flatten(adptripeng))  # -> BuildingCurves, BuildingHits, BuildingTrips
amenhits = AmenityHits(Trips=flatten(adptripeng))  # -> Amenity, AmenityHits, AmenityHosts, AmTrips
sthits = StreetHits(UrbanoModel=build_urbano_model.UrbanoModel, Trips=flatten(adptripeng))  # -> StreetCurves, StreetHits, StTrips
walksc = TripWalkscore(Trip=adptripeng)
area_2 = Area(Geometry=bldghits.BuildingCurves)  # -> flatten(Area), flatten(Centroid)
curve_middle = CurveMiddle(Curve=sthits.StreetCurves)  # -> flatten(Midpoint)
# if building is close to high strret hits it
# will be commercial and less will be residential
geometry = Geometry(list_item_7)
area_3 = Area(Geometry=geometry)  # -> Area, Centroid
bounds_2 = Bounds(Numbers=sthits.StreetHits)
project = Project(Geometry=area_3.Centroid, Plane=PlaneXY(0, 0, 0))  # -> Geometry, Transform
deconstruct_domain_2 = DeconstructDomain(Domain=bounds_2)  # -> Start, End
division_3 = Division(A=deconstruct_domain_2.End, B="3")
closest_points = ClosestPoints(Point=project.Geometry, Cloud=flatten(area_2.Centroid), Count="1")  # -> ClosestPoint, CPIndex, Distance
closest_points_2 = ClosestPoints(Point=project.Geometry, Cloud=flatten(curve_middle), Count="5")  # -> ClosestPoint, CPIndex, Distance
smaller_than_2 = SmallerThan(FirstNumber=closest_points.Distance, SecondNumber=Slider(200, range=0..1000))  # -> SmallerThan, OrEqualTo
list_item_8 = ListItem(List=sthits.StreetHits, Index=closest_points.CPIndex, Wrap=True)
list_item_9 = ListItem(List=sthits.StreetHits, Index=closest_points_2.CPIndex, Wrap=True)
bounds_3 = Bounds(Numbers=list_item_8)
bounds_4 = Bounds(Numbers=list_item_9)
deconstruct_metadata_5 = DeconstructMetadata(Metadata=stream_filter_2)  # -> Keys, graft(Values)
panel_8 = Panel(closest_points_2.CPIndex)
deconstruct_domain_3 = DeconstructDomain(Domain=bounds_3)  # -> Start, End
deconstruct_domain_4 = DeconstructDomain(Domain=bounds_4)  # -> Start, End
smaller_than_3 = SmallerThan(FirstNumber=deconstruct_domain_4.End, SecondNumber=division_3)  # -> SmallerThan, OrEqualTo
panel_9 = Panel(deconstruct_metadata_5.Values)
explode_tree_2 = ExplodeTree(Data=deconstruct_metadata_5.Values)  # -> Branch0, Branch1, Branch2, Branch3, Branch4
dispatch_2 = Dispatch(List=deconstruct_domain_3.End, DispatchPattern=smaller_than_2.SmallerThan)  # -> ListA, ListB
dispatch_3 = Dispatch(List=deconstruct_domain_4.End, DispatchPattern=smaller_than_3.SmallerThan)  # -> ListA, ListB

geometry_2 = Geometry(geometry)
custom_preview_7 = CustomPreview(Geometry=list_item_7, Material=ColourSwatch(SwatchColor=RGB(222, 164, 164)))

boolean = Boolean(smaller_than_3.SmallerThan)

curve_3 = Curve(bldghits.BuildingCurves)
number = Number(bldghits.BuildingHits)
trip = Trip(bldghits.BuildingTrips)

boolean_2 = Boolean(smaller_than_2.SmallerThan)

geometry_3 = Geometry(dispatch.ListA)
geometry_4 = Geometry(dispatch.ListB)

curve_4 = Curve(sthits.StreetCurves)
number_2 = Number(sthits.StreetHits)
context_print_3 = ContextPrint(NearbyAminityIn200mRadius=boolean_2)
context_print_4 = ContextPrint(CommercialResidential=boolean)
context_print_5 = ContextPrint(ProposedBuildingName=explode_tree_2.Branch0)
context_bake_2 = ContextBake(ProposedBuilding=geometry_2)
context_print_6 = ContextPrint(TotalBuiltUpArea=explode_tree_2.Branch3)
context_print_7 = ContextPrint(AreaPerPerson=explode_tree_2.Branch4)
context_bake_3 = ContextBake(BuildingCurve=curve_3)
context_print_8 = ContextPrint(AminityHits=number)
context_bake_4 = ContextBake(StreetCurve=curve_4)
context_print_9 = ContextPrint(StreetHits=number_2)
context_print_10 = ContextPrint(Occupancy=explode_tree_2.Branch2)
context_print_11 = ContextPrint(Height=explode_tree_2.Branch1)
context_bake_5 = ContextBake(CommercialBuildings=geometry_4)
context_bake_6 = ContextBake(ResidentialBuildings=geometry_3)
